# Grasshopper definition prep_data.gh (Grasshopper 1.0.7)

txt = Text(["time,MT_001,MT_002,MT_003,MT_004,MT_005,MT_006,MT_007,MT_008,MT_009,MT_010,MT_011,MT_012,MT_013,MT_014,MT_015,MT_016,MT_017,MT_018,MT_019,MT_020", "1/1/12 1:00,0.999553,1,0.999553,1,0.999553,1,0.999553,1,0.999553,1,0.999553,1,0.999553,1,0.999553,1,0.999553,1,0.999553,1", "1/1/12 2:00,0.999957,1.000522,0.999908,0.999717,0.998848,0.999141,0.998773,0.999583,0.999965,1.001377,1.000055,0.999665,0.998812,0.999125,0.998779,0.999618,0.99984,1.000545,0.99998,1.000347", "1/1/12 3:00,1.00036,1.001045,1.000264,0.999435,0.998143,0.998282,0.997993,0.999166,1.000377,1.002754,1.000558,0.99933,0.998072,0.99825,0.998006,0.999236,1.000127,1.001091,1.000407,1.000695", "1/1/12 4:00,1.000764,1.001567,1.000619,0.999152,0.997439,0.997423,0.997214,0.998748,1.000789,1.004131,1.001061,0.998995,0.997331,0.997374,0.997232,0.998854,1.000414,1.001636,1.000835,1.001042", "1/1/12 5:00,1.001168,1.002089,1.000975,0.998869,0.996734,0.996563,0.996434,0.998331,1.001201,1.005508,1.001563,0.99866,0.996591,0.996499,0.996458,0.998471,1.000701,1.002181,1.001262,1.00139"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])
split = SplitList(List=txt, Index=1)  # -> ListA, ListB
split_2 = TextSplit(Text=split.ListB, Separators=",")
item = ListItem(List=split_2, Index=1, Wrap=True)  # -> flatten(Item)
item_2 = ListItem(List=item, Index=0, Wrap=True)
panel = Panel(item_2)
item_3 = ListItem(List=split_2, Index=0, Wrap=True)  # -> flatten(Item)
crv = Curve([<curve referenced from the Rhino model> x101])
obj = CSharpScript(obj=crv)  # -> name; inputs obj: Guid
# ---------- obj: C# ----------
var the_obj = doc.Objects.Find(obj);

name = the_obj.Attributes.Name;
# ---------- end obj ----------
dom = ConstructDomain(DomainStart=0, DomainEnd=6.283185307)
split_3 = TextSplit(Text=obj, Separators="_")
range = Range(Domain=dom, Steps=20)
item_4 = ListItem(List=split_3, Index=0, Wrap=True)  # -> Item, flatten(Item1)
lng = ListLength(List=item_3)
cull_i = CullIndex(List=range, Indices=0, Wrap=True)
sort = SortList(Keys=item_4.Item1, ValuesA=crv)  # -> Keys, ValuesA
X = UnitX(Factor=1)
divide = DivideCurve(Curve=sort.ValuesA, Count=10, Kinks=False)  # -> simplify(Points), Tangents, Parameters
line = LineSDL(Start=Point(0, 0, 0), Direction=X, Length=10)
pline = PolyLine(Vertices=divide.Points, Closed=True)
rotate = Rotate(Geometry=line, Angle=cull_i, Plane=PlaneXY(0, 0, 0))  # -> Geometry, Transform
pcen = PolygonCenter(Polyline=pline)  # -> CenterV, CenterE, CenterA
addition = Addition(A="7*24", B=lng)
rev = Reverse(Vector=pcen.CenterV)
pdecon = Deconstruct(Point=pcen.CenterV)  # -> XComponent, YComponent, ZComponent
range_2 = Range(Domain=Domain(0, 1), Steps=expr("x-1", addition))
move = Move(Geometry=graft(crv), Motion=rev)  # -> simplify(Geometry), Transform
ccx = CurveCurve(CurveA=flatten(rotate.Geometry), CurveB=move.Geometry)  # -> Points, ParamsA, ParamsB
vlen = VectorLength(Vector=ccx.Points)
path_mapper = PathMapper(vlen, source="{A;B}", target="{A}")
flip = FlipMatrix(Data=path_mapper)
interp = InterpolateData(Data=flip, Parameter=range_2, Interpolation=3)
viewer = ParamViewer(interp)
item_5 = ListItem(List=viewer, Index=0, Wrap=True)  # -> Item, Item1, Item2, Item3
split_4 = SplitList(List=interp, Index=lng)  # -> ListA, ListB
branch = TreeBranch(Tree=interp, Path=item_5.Item2, MaintainPaths=True)  # -> flatten(Branch)
flip_2 = FlipMatrix(Data=split_4.ListA)
flip_3 = FlipMatrix(Data=split_4.ListB)
concat = Concatenate(FragmentA=item_3, FragmentB=",")
join = TextJoin(Text=flip_3, Join=",")  # -> flatten(Result)
join_2 = TextJoin(Text=flip_2, Join=",")  # -> flatten(Result)
lng_2 = ListLength(List=branch)
concat_2 = Concatenate(FragmentA=concat, FragmentB=join_2)
panel_2 = Panel(join)
merge = Merge(Data1=flatten(split.ListA), Data2=flatten(concat_2))
series = Series(Start=0, Step=0.01, Count=lng_2)
panel_3 = Panel(merge)
multiplication = Multiplication(A="100", B=branch)
panel_4 = Panel(multiplication)
pt = ConstructPoint(XCoordinate=series, YCoordinate=multiplication, ZCoordinate=0)
pline_2 = PolyLine(Vertices=pt, Closed=False)
