# Grasshopper definition rebuild_island.gh (Grasshopper 1.0.7)

path = FilePath("C:\Users\wzesk\Documents\GitHub\littoral\toy_island\raw_island_d.csv")
file = ReadFile(File=path, PerLineParse=True)
split = SplitList(List=file, Index=1)  # -> flatten(ListA), ListB
item = ListItem(List=split.ListB, Index=Slider(100001, range=0..100001), Wrap=True)
split_2 = TextSplit(Text=split.ListB, Separators=",")
split_3 = TextSplit(Text=item, Separators=",")
split_4 = SplitList(List=split_2, Index=1)  # -> flatten(ListA), ListB
split_5 = SplitList(List=split_3, Index=1)  # -> flatten(ListA), ListB
dom = ConstructDomain(DomainStart=0, DomainEnd=6.283185307)
X = UnitX(Factor=1)
range = Range(Domain=dom, Steps=20)
cull_i = CullIndex(List=range, Indices=0, Wrap=True)
rotate = Rotate(Geometry=X, Angle=cull_i, Plane=PlaneXY(0, 0, 0))  # -> Geometry, Transform
line = LineSDL(Start=Point(0, 0, 0), Direction=rotate.Geometry, Length=split_5.ListB)
end = EndPoints(Curve=line)  # -> Start, End
intcrv = Interpolate(Vertices=end.End, Degree=3, Periodic=True, KnotStyle=1)  # -> Curve, Length, Domain
