# Grasshopper definition tracking_tests.gh (Grasshopper 1.0.7)

list = ValueList({"SLR/Budget": 0, "Migration": 1, "Rotation": 2, "Oscillation": 3}, selected="Oscillation")
base_radius = Panel("3000")
steps = Panel("1500")
cluster = Cluster(base_radius=base_radius, steps=steps, type=list)  # -> _2d, _3d
crv = Curve(cluster._2d)
crv_2 = Curve(cluster._3d)
shift = ShiftList(List=cluster._2d, Shift=1, Wrap=False)  # -> simplify(graft(List)); disabled
shift_2 = ShiftList(List=cluster._2d, Shift=-1, Wrap=False)  # -> simplify(graft(List)); disabled
lng = ListLength(List=shift_2)  # disabled
panel = Panel("2000-01-01")  # disabled
panel_2 = Panel(lng)  # disabled
divide = DivideCurve(Curve=shift, Count="200", Kinks=False)  # -> Points, Tangents, Parameters; disabled
crv_cp = CurveClosestPoint(Point=divide.Points, Curve=shift_2)  # -> Point, Parameter, simplify(Distance); disabled
incurve = PointInCurve(Point=divide.Points, Curve=shift_2)  # -> Relationship, Point; disabled
c_script = CSharpScript(start_time=panel, len=panel_2)  # -> graft(time_series); inputs len: Int32; disabled
# ---------- c_script: C# ----------
    List<DateTime> dates = new List<DateTime>();

    for(int i = 0 ; i < len ; i++){
      dates.Add(start_time.AddDays(i));
    }
    time_series = dates;
# ---------- end c_script ----------
expression = Expression(x=incurve.Relationship, Expression="if(x == 0,1,-1)")  # disabled
viewer = ParamViewer(crv_cp.Distance)  # disabled
txt = Text(flatten(c_script))  # disabled
item = ListItem(List=viewer, Index=0, Wrap=True)  # disabled
split = TextSplit(Text=txt, Separators=" ")  # disabled
multiplication = Multiplication(A=expression, B=crv_cp.Distance)  # -> simplify(Result); disabled
panel_3 = Panel(" 00:00:00")  # disabled
item_2 = ListItem(List=split, Index=0, Wrap=True)  # -> flatten(Item); disabled
concat = Concatenate(FragmentA=item_2, FragmentB=panel_3)  # disabled
panel_4 = Panel(multiplication)  # disabled
txt_2 = Text(concat)  # disabled
concat_2 = Concatenate(FragmentA=txt_2, FragmentB=",")  # disabled
join = TextJoin(Text=panel_4, Join=",")  # -> flatten(Result); disabled
branch = TreeBranch(Tree=multiplication, Path=item, MaintainPaths=True)  # -> flatten(Branch); disabled
lng_2 = ListLength(List=branch)  # disabled
panel_5 = Panel("time")  # disabled
c_script_2 = CSharpScript(num=lng_2)  # -> series; inputs num: Int32; disabled
# ---------- c_script_2: C# ----------
    List<string> numbers = new List<string>();
    for(int i = 0 ; i < num ; i++){
      numbers.Add("TR_" + i.ToString("D3"));
    }
    series = numbers;
# ---------- end c_script_2 ----------
concat_3 = Concatenate(FragmentA=panel_5, FragmentB=",")  # disabled
lng_3 = ListLength()  # disabled
split_2 = SplitList(List=concat_2, Index=lng_3)  # -> ListA, ListB; disabled
join_2 = TextJoin(Text=c_script_2, Join=",")  # disabled
concat_4 = Concatenate(FragmentA=concat_3, FragmentB=join_2)  # disabled
concat_5 = Concatenate(FragmentA=split_2.ListA, FragmentB=join)  # disabled
merge = Merge(Data1=flatten(concat_4), Data2=flatten(concat_5))  # disabled
c_script_3 = CSharpScript(data=merge, path="D:\Github\littoral\toy_island\dharavandhoo.csv", save=Toggle(False))  # -> out; inputs data: list of String, path: String, save: Boolean; disabled
# ---------- c_script_3: C# ----------
    if(save){
      using (var file = System.IO.File.CreateText(path))
      {
        foreach(var arr in data)
        {
          file.WriteLine(string.Join(",", arr));
        }
      }
    }
# ---------- end c_script_3 ----------
panel_6 = Panel(c_script_3)  # disabled

# ==== cluster Cluster
steps = ClusterInput()
base_radius = ClusterInput()
type = ClusterInput()
base_radius_2 = Number(base_radius)
steps_2 = Integer(steps)
type_2 = Integer(type)
vec = Vector(Vector(-0.8199580837, 0.5724235678, 0))
cir = Circle(Plane=PlaneXY(0, 0, 0), Radius=base_radius_2)
panel = Panel("1.01")
amp = Amplitude(Vector=vec, Amplitude="1")
series = Series(Start=0, Step="1", Count=steps_2)
scale_nu = ScaleNU(Geometry=cir, Plane=PlaneXY(0, 0, 0), ScaleX=0.8, ScaleY=1.1, ScaleZ=1)  # -> Geometry, Transform
graph = GraphMapper(series, x0=0, x1=1500, y0=0, y1=1, container_name="Sine", Equation_px=[0, 0.05932884663], Equation_py=[0, 0.9825236201])
expression = Expression(x=steps_2, y="100", z="1", Expression="(x/y)*z")
dom = ConstructDomain(DomainStart=expr("-x", expression), DomainEnd=expression)
bnd = Bounds(Numbers=graph)
remap = RemapNumbers(Value=graph, Source=bnd, Target=dom)  # -> Mapped, Clipped
amp_2 = Amplitude(Vector=vec, Amplitude=remap.Mapped)
scale = Scale(Center=Point(0, 0, 0), Factor=0.999)  # -> Geometry, Transform
move = Move(Motion=amp)  # -> Geometry, Transform
rotate = Rotate(Angle=".001", Plane=PlaneXY(0, 0, 0))  # -> Geometry, Transform
move_2 = Move(Motion=amp_2)  # -> Geometry, Transform
dup = DuplicateData(Data=scale.Transform, Number=steps_2, Order=True)
dup_2 = DuplicateData(Data=rotate.Transform, Number=steps_2, Order=True)
dup_3 = DuplicateData(Data=move.Transform, Number=steps_2, Order=True)
filter = StreamFilter(Gate=type_2, Stream0=dup, Stream1=dup_3, Stream2=dup_2, Stream3=move_2.Transform)
Z = UnitZ(Factor=10)
crv = Curve(scale_nu.Geometry)
move_3 = Move(Motion=Z)  # -> Geometry, Transform
c_script = CSharpScript(x=crv, t=filter)  # -> _2d; inputs x: GeometryBase, t: list of Transform
# ---------- c_script: C# ----------
    List<Rhino.Geometry.GeometryBase> geom_out = new List<Rhino.Geometry.GeometryBase>();
    var current = x;
    foreach (Rhino.Geometry.Transform trans in t){
      geom_out.Add(current);
      x.Transform(trans);
      current = x.Duplicate();
    }
    A = geom_out;
# ---------- end c_script ----------
_2d = ClusterOutput(c_script)
c_script_2 = CSharpScript(x=crv, t=filter, v=move_3.Transform)  # -> _3d; inputs x: GeometryBase, t: list of Transform, v: Transform
# ---------- c_script_2: C# ----------
    List<Rhino.Geometry.GeometryBase> geom_out = new List<Rhino.Geometry.GeometryBase>();
    var current = x;
    foreach (Rhino.Geometry.Transform trans in t){
      geom_out.Add(current);
      x.Transform(trans);
      x.Transform(v);
      current = x.Duplicate();
    }
    A = geom_out;
# ---------- end c_script_2 ----------
_3d = ClusterOutput(c_script_2)
