# Grasshopper definition universal_coastline_tracker.gh (Grasshopper 1.0.7)

crv = Curve(<curve referenced from the Rhino model>)
crv_2 = Curve(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)
crv_3 = Curve(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)
crv_4 = Curve(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)
trim = TrimWithRegion(Curve=crv_2, Region=crv_4)  # -> reparameterize(Inside), Outside
trim_2 = TrimWithRegion(Curve=crv_3, Region=crv_4)  # -> reparameterize(Inside), Outside
crv_5 = Curve(trim.Inside)
cluster = Cluster(crv=trim_2.Inside, int="20")  # -> pt_2, vec_2
cluster_2 = Cluster_2(crv=crv_2, pt=cluster.pt_2, vec=cluster.vec_2, dist="50")  # -> pt_4, vec_4
vdis = VectorDisplay(Anchor=cluster_2.pt_4, Vector=cluster_2.vec_4)
cluster_3 = Cluster_2(crv=crv, pt=cluster_2.pt_4, vec=cluster_2.vec_4, dist="50")  # -> pt_4, vec_4
ln = Line(StartPoint=cluster.pt_2, EndPoint=cluster_2.pt_4)
crv_6 = Curve(crv_4)
ln_2 = Line(StartPoint=cluster_2.pt_4, EndPoint=cluster_3.pt_4)
vdis_2 = VectorDisplay(Anchor=cluster_3.pt_4, Vector=cluster_3.vec_4)

# ==== cluster Cluster
int = ClusterInput()
crv = ClusterInput()
crv_2 = Curve(crv)
int_2 = Integer(int)
divide = DivideCurve(Curve=crv_2, Count=expr("x+2", int_2), Kinks=False)  # -> Points, Tangents, Parameters
midpt = CurveMiddle(Curve=crv_2)
panel = Panel("""0
-1""")
cull_i = CullIndex(List=divide.Parameters, Indices=panel, Wrap=True)
hframe = HorizontalFrame(Curve=crv_2, Parameter=cull_i)
deplane = DeconstructPlane(Plane=hframe)  # -> Origin, XAxis, YAxis, ZAxis
rev = Reverse(Vector=midpt)
rev_2 = Reverse(Vector=deplane.YAxis)
unit = UnitVector(Vector=rev)
avr = Average(Input=deplane.YAxis)
avr_2 = Average(Input=rev_2)
dist = Distance(PointA=unit, PointB=avr)
dist_2 = Distance(PointA=unit, PointB=avr_2)
larger = LargerThan(FirstNumber=dist, SecondNumber=dist_2)  # -> LargerThan, OrEqualTo
filter = StreamFilter(Gate=larger.LargerThan, Stream0=rev_2, Stream1=deplane.YAxis)
pt = Point(deplane.Origin)
vec = Vector(filter)
pt_2 = ClusterOutput(pt)
vec_2 = ClusterOutput(vec)

# ==== cluster Cluster_2
crv = ClusterInput()
pt = ClusterInput()
vec = ClusterInput()
dist = ClusterInput()
pt_2 = Point(pt)
vec_2 = Vector(vec)
dist_2 = Number(dist)
crv_2 = Curve(crv)
amp = Amplitude(Vector=vec_2, Amplitude=expr("-x", dist_2))
move = Move(Geometry=pt_2, Motion=amp)  # -> Geometry, Transform
crv_3 = Curve(crv_2)
line = LineSDL(Start=move.Geometry, Direction=vec_2, Length=expr("x*2", dist_2))
clx = CurveLine(Curve=crv_3, Line=line)  # -> Points, Params, Count
crv_cp = CurveClosestPoint(Point=clx.Points, Curve=graft(line))  # -> Point, Parameter, Distance
sort = SortList(Keys=crv_cp.Parameter, ValuesA=clx.Params)  # -> Keys, reverse(ValuesA)
midpt = CurveMiddle(Curve=crv_3)
item = ListItem(List=sort.ValuesA, Index=0, Wrap=True)  # -> flatten(Item)
hframe = HorizontalFrame(Curve=crv_3, Parameter=item)
rev = Reverse(Vector=midpt)
deplane = DeconstructPlane(Plane=hframe)  # -> Origin, XAxis, YAxis, ZAxis
unit = UnitVector(Vector=rev)
rev_2 = Reverse(Vector=deplane.YAxis)
avr = Average(Input=deplane.YAxis)
avr_2 = Average(Input=rev_2)
dist_3 = Distance(PointA=unit, PointB=avr)
dist_4 = Distance(PointA=unit, PointB=avr_2)
larger = LargerThan(FirstNumber=dist_3, SecondNumber=dist_4)  # -> LargerThan, OrEqualTo
filter = StreamFilter(Gate=larger.LargerThan, Stream0=rev_2, Stream1=deplane.YAxis)
pt_3 = Point(deplane.Origin)
vec_3 = Vector(filter)
pt_4 = ClusterOutput(pt_3)
vec_4 = ClusterOutput(vec_3)
